# Grasshopper definition moveMachine.gh (Grasshopper 1.0.7)

createmachine = GhPythonScript()  # -> out, machineObject
# ---------- createmachine: Python ----------
# Example machine for testing importing into Rhino
# Nadya for Brian, 2019

#------IMPORTS-------
from pygestalt import nodes
from pygestalt import interfaces
from pygestalt import machines
from pygestalt import functions
from pygestalt.machines import elements
from pygestalt.machines import kinematics
from pygestalt.machines import state
from pygestalt.utilities import notice
import time
import io
import scriptcontext


#------VIRTUAL MACHINE------
# here we describe the kinematics of our machine
# this one uses two direct drive stages with 8mm leadscrews for both X and Y

class virtualMachine(machines.virtualMachine):

	def initInterfaces(self):
		if self.providedInterface: self.fabnet = self.providedInterface		#providedInterface is defined in the virtualMachine class.
		else: self.fabnet = interfaces.gestaltInterface('FABNET', interfaces.serialInterface(baudRate = 115200, interfaceType = 'ftdi', portName = 'COM6'))

	def initControllers(self):
		self.xAxisNode = nodes.networkedGestaltNode('X Axis', self.fabnet, filename = 'module_086_005a.py', persistence = self.persistence)
		self.yAxisNode = nodes.networkedGestaltNode('Y Axis', self.fabnet, filename = 'module_086_005a.py', persistence = self.persistence)

		self.xyNode = nodes.compoundNode(self.xAxisNode, self.yAxisNode)

	def initCoordinates(self):
		self.position = state.coordinate(['mm', 'mm'])

	def initKinematics(self):
        #each stage uses a microstepping controller with 4 subdivisions per step. The step angle is 1.8 degrees. The 4 start lead screw has a pitch of 2mm, so one full rotation results in 8mm of travel
		self.xAxis = elements.elementChain.forward([elements.microstep.forward(4), elements.stepper.forward(1.8), elements.leadscrew.forward(8), elements.invert.forward(True)])
		self.yAxis = elements.elementChain.forward([elements.microstep.forward(4), elements.stepper.forward(1.8), elements.leadscrew.forward(8), elements.invert.forward(False)])
		self.stageKinematics = kinematics.direct(2)	#direct drive on all axes

	def initFunctions(self):
        #move is the only function we have really implemented for this machine
		self.move = functions.move(virtualMachine = self, virtualNode = self.xyNode, axes = [self.xAxis, self.yAxis], kinematics = self.stageKinematics, machinePosition = self.position,planner = 'null')
		self.jog = functions.jog(self.move)	#an incremental wrapper for the move function
		pass

	def initLast(self):
		#self.machineControl.setMotorCurrents(aCurrent = 0.8, bCurrent = 0.8, cCurrent = 0.8)
		#self.xNode.setVelocityRequest(0)	#clear velocity on nodes. Eventually this will be put in the motion planner on initialization to match state.
		pass

	def publish(self):
		#self.publisher.addNodes(self.machineControl)
		pass

	def getPosition(self):
		return {'position':self.position.future()}

	def setPosition(self, position  = [None]):
		self.position.future.set(position)

	def setSpindleSpeed(self, speedFraction):
		#self.machineControl.pwmRequest(speedFraction)
		pass

#----end of virtual machine description------#

machineObject=scriptcontext.sticky.get('machineObject')
#------using the virtual machine------
if not machineObject:
	# The persistence file remembers the node you set.
    # It'll generate the first time you run the
	# nodes. If you are hooking up a new node, delete
    # the previous persistence file. So I guess we need write access?
    import os
    os.chdir("c:\dev")

    machineObject = virtualMachine(persistenceFile = "brian.vmp", name="brian")
    scriptcontext.sticky['machineObject'] = machineObject
# ---------- end createmachine ----------
pt = ConstructPoint(XCoordinate=Slider(156, range=0..300), YCoordinate=Slider(9, range=0..20), ZCoordinate=0)
movemachine = GhPythonScript(run=Toggle(False), machineObject=createmachine.machineObject, pts=pt)  # -> out, a; inputs run: Boolean, pts: list of Point3d
# ---------- movemachine: Python ----------
import time
# This is for how fast the motors will move
machineObject.xyNode.setVelocityRequest(8)

# Some random moves to test, in the future maybe these can come from GH!
#moves = [[10,10],[20,20],[10,10],[0,0]]

moves = []
for pt in pts:
    move = [pt.X, pt.Y]
    moves.append(move)

# Move!
for move in moves:
    machineObject.move(move, 0)
    status = machineObject.xAxisNode.spinStatusRequest()
    # This checks to see if the move is done. Because the nodes in the
    # compoundnode are synced, you only need to check one. We are checking X
    while status['stepsRemaining'] > 0:
        time.sleep(0.001)
        status = machineObject.xAxisNode.spinStatusRequest()
# machineObject.fabnet.disconnect()
# ---------- end movemachine ----------
